# Dynamo graph lod3_casm.dyn (Dynamo 2.0.2.6826)

# group: PARAMETERS - main
tunnel_alignment = DSModelElementSelection()  # 1 picked in the model; graph input
ring_lenght = DoubleSlider(250, range=0..1500 step 50)  # graph input
curvature = CodeBlock { 20000; }
model_path = StringInput("D:/git-satbim_internal/Example_1/casm_lin_lod3/")  # graph input
tbm_level_of_detail_lod1_lod2 = IntegerSlider(2, range=0..3 step 1)  # "TBM-Level_of_detail -Lod1 Lod2 Lod3"; graph input
soil_level_of_detail_0_1_2 = IntegerSlider(2, range=0..3 step 1)  # graph input
building_level_of_detail_lod1 = DoubleSlider(0, range=0..3 step 1)  # "BUILDING-Level_of_detail -Lod1 Lod2 Lod3"; graph input
lining_level_of_detail_lod1_lod2 = IntegerSlider(3, range=0..3 step 1)  # "LINING-Level_of_detail -Lod1 Lod2 Lod3"; graph input
excavation_radius = CodeBlock { 505; }
model_name = StringInput("lod3")  # graph input

# group: Creates Adaptive Alignment
create = List.Create(item0=tunnel_alignment)
curves = Element.Curves(element=create)
number = DoubleInput(0.001)  # graph input
pointAtSegmentLength = Curve.PointAtSegmentLength(curve=curves, segmentLength=number)
pointsAtSegmentLengthFromPoint = Curve.PointsAtSegmentLengthFromPoint(curve=curves, point=pointAtSegmentLength, segmentLength=ring_lenght)
flatten = List.Flatten(list=pointsAtSegmentLengthFromPoint)
alpha_ring_inclinination = CodeBlock(b=ring_lenght, a=curvature) { apha= Math.Acos(1.0-(b*b)/(2*a*a))*Math.PI/180; }
calculation_of_the_adaptive = Python(IN[0]=flatten, IN[1]=alpha_ring_inclinination, IN[2]=model_path)  # "Calculation of the adaptive alignment"
# ---------- calculation_of_the_adaptive.python (167 lines) ----------
import clr
import sys
import math
pyt_path = r'C:\Program Files (x86)\IronPython 2.7\Lib'
sys.path.append(pyt_path)
import os
clr.AddReference('ProtoGeometry')
from Autodesk.DesignScript.Geometry import *
#The inputs to this node will be stored as a list in the IN variables.
dataEnteringNode = IN
#a=Point.ByCoordinates(IN[0],IN[0],IN[0])
model_path=IN[2]
lx=[]
ly=[]
lz=[]
lx_new=[]
ly_new=[]
distance=[]
list_beta=[]
list_beta_abs=[]
list_or=[]
list_points=[]
lx_mid=[]
ly_mid=[]
list_mid_points=[]
alpha= IN[1]
list_all_points=[]


for i in range (0,len(IN[0])):
	#a=0
	#b=0
	a=IN[0][i].X
	b=IN[0][i].Y
	c=IN[0][i].Z
	lx.append(a)
	ly.append(b)
	lz.append(c)
dist=math.sqrt((lx[1]-lx[0])*(lx[1]-lx[0])+(ly[1]-ly[0])*(ly[1]-ly[0]))
beta=math.atan((ly[1]-ly[0])/(lx[1]-lx[0]))
list_beta.append(beta)
#list_or.append(1)
if beta >0:
	list_or.append(1)
else:
	list_or.append(0)


lx_new.append(lx[0])
lx_new.append(lx[1])
ly_new.append(ly[0])
ly_new.append(ly[1])

for i in range (2,len(IN[0])):
	x1_n=lx_new[i-1]+dist*math.cos(beta)
	y1_n=ly_new[i-1]+dist*math.sin(beta)
	#x2_n=lx_new[i-1]+dist*math.cos(beta+alpha)
	#y2_n=ly_new[i-1]+dist*math.sin(beta+alpha)
	if list_or[i-2]==1:
		x2_n=lx_new[i-1]+dist*math.cos(beta-alpha)
	else:
		x2_n=lx_new[i-1]+dist*math.cos(beta+alpha)
	if list_or[i-2]==1:
		y2_n=ly_new[i-1]+dist*math.sin(beta-alpha)
	else:
		y2_n=ly_new[i-1]+dist*math.sin(beta+alpha)
	dist1=	math.sqrt((x1_n-lx[i])*(x1_n-lx[i])+(y1_n-ly[i])*(y1_n-ly[i]))
	dist2=	math.sqrt((x2_n-lx[i])*(x2_n-lx[i])+(y2_n-ly[i])*(y2_n-ly[i]))
	if dist1<dist2:
		lx_new.append(x1_n)
		ly_new.append(y1_n)
		beta=beta
		if list_or[i-2]==1:
			list_or.append(0)
		else:
			list_or.append(1)
	else:
		lx_new.append(x2_n)
		ly_new.append(y2_n)
		if list_or[i-2]==1:
			list_or.append(1)
			beta=beta-alpha
		else:
			list_or.append(0)
			beta=beta+alpha
	list_beta.append(beta)
	
	
#CRETAES A FILE OF ROTATIONS FOR LINING RINGS
path=model_path+"/input_files/"

if not os.path.exists(path):
    os.makedirs(path)

ifile = open(path+"lining_ring_rotations.dat", 'a' )	
#NOTE: strats from 1 because the first ring is not creted!
for rot in range (1, len(list_or)):

	ifile.write(str(list_or[rot])+"\n" )
ifile.close()
	


for i in range (0, len(lx_new)):
	point=Point.ByCoordinates(lx_new[i],ly_new[i],lz[i])
	list_points.append(point)
	
#create list of vectors and measure angle
list_vectors=[]
###NOT USED LATER
for i in range (1, len(list_points)):
	v=Vector.ByTwoPoints(list_points[i-1],list_points[i] )
	list_vectors.append(v)



for i in range (1, len(lx_new)):
	dist1=math.sqrt((lx_new[i]-lx_new[i-1])*(lx_new[i]-lx_new[i-1])+(ly_new[i]-ly_new[i-1])*(ly_new[i]-ly_new[i-1]))	
	distance.append(dist1)
for i in range (0,len(lx_new)-1):
	if list_or[i]==1:
		#m=lx_new[i]+dist/2*math.cos((list_beta[i]-alpha/2))
		#n=ly_new[i]+dist/2*math.sin((list_beta[i]+alpha/2))
		#m=lx_new[i]+dist/2*math.cos((list_beta[i]-alpha/4))
		#n=ly_new[i]+dist/2*math.sin((list_beta[i]+alpha/4))
		m=lx_new[i]+distance[i]/2/(math.cos(alpha/4.0))*math.cos((list_beta[i]+alpha/4.0))
		#n=ly_new[i]+distance[i]/2/(math.sin(alpha/4.0))*math.sin((list_beta[i]+alpha/4.0))
		n=ly_new[i]+distance[i]/2/(math.cos(alpha/4.0))*math.sin((list_beta[i]+alpha/4.0))
		
	else:
		#m=lx_new[i]+dist/2*math.cos((list_beta[i]+alpha/2))
		#n=ly_new[i]+dist/2*math.sin((list_beta[i]-alpha/2))
		m=lx_new[i]+distance[i]/2.0/(math.cos(alpha/4.0))*math.cos((list_beta[i]-alpha/4.0))
		n=ly_new[i]+distance[i]/2.0/(math.cos(alpha/4.0))*math.sin((list_beta[i]-alpha/4.0))
	lx_mid.append(m)
	ly_mid.append(n)

for i in range (0, len(lx_mid)):
	point=Point.ByCoordinates(lx_mid[i],ly_mid[i],lz[i])
	list_mid_points.append(point)
	
for i in range (0, (len(list_points)-1)):
	list_all_points.append(list_points[i])
	list_all_points.append(list_mid_points[i])
list_all_points.append(list_points[len(list_points)-1])
	
#x=math.cos(IN[1])

#rad=math.acos(0.98)
	
#a=IN[0][0].X
#Assign your output to the OUT variable.
OUT = list_or

OUT = list_beta

OUT= list_points
OUT= list_mid_points
OUT = list_all_points
#OUT=lx
OUT = list_or
OUT = list_all_points
for i in range (0, len(list_beta)):
	an=list_beta[i]*180/math.pi
	list_beta_abs.append(an)
	
#OUT = list_beta_abs
# ----------------------------------------

# group: Parameters TBM
TBM_lenght = IntegerSlider(750, range=500..20000 step 100)  # graph input
TBM_radus = IntegerSlider(494, range=100..20000 step 50)  # graph input
tbm_conicity = DoubleInput(0.5)  # graph input
tbm_shield_thickness = DoubleInput(25)  # graph input
tbm_wall_distance = DoubleInput(300)  # graph input
tbm_wall_thickness = DoubleInput(100)  # graph input
lining_rings_under_shield = DoubleInput(1)  # graph input
linig_ring_length = DoubleInput(150)  # graph input
number_of_segments = DoubleInput(7)  # graph input
r_hydraulic_jacks = DoubleInput(5)  # graph input
TBM_radius = DoubleInput(5000)  # graph input
TBM_length = DoubleInput(10000)  # graph input

# group: Families TBM LOD 1 2 3
family_types = FamilyTypes(index=207)  # graph input
family_types_2 = FamilyTypes(index=208)  # graph input
family_types_3 = FamilyTypes(index=209)  # graph input
family_types_4 = FamilyTypes(index=142)  # graph input

volume_loss = DoubleInput(0.5)  # graph input

# group: Parameters of the Builiding including LOD
num_of_columns_x = DoubleInput(4)  # graph input
num_of_columns_Y = DoubleInput(3)  # graph input
number_of_floors = DoubleInput(3)  # graph input
x_span = DoubleSlider(600.01, range=600..10000 step 500)  # graph input
y_span = DoubleSlider(600, range=600..10000 step 500)  # graph input
floor_height = DoubleSlider(500, range=200..2000 step 100)  # graph input
floor_thickness = DoubleInput(80)  # graph input
columns_a = DoubleInput(50)  # graph input
columns_b = DoubleInput(50)  # graph input

# group: Material parameters Building
material_1_linear_elastic_2 = IntegerSlider(1, range=1..3 step 1)  # "Material: 1- Linear Elastic; 2 - Plastic; 3 - Damage"; graph input
young_modulus = DoubleInput(10000)  # graph input
poisons_ratio = DoubleInput(0.3)  # graph input
density = DoubleInput(250)  # graph input
create_2 = List.Create(item0=material_1_linear_elastic_2, item1=young_modulus, item2=poisons_ratio, item3=density)

# group: Parameters Lining and grouting
linig_outer_radius = DoubleInput(485)  # graph input
lining_inner_radius = DoubleInput(440)  # graph input

segment_type = IntegerSlider(71, range=61..71 step 10)  # graph input
boolean = BoolSelector(false)  # graph input
grouting_Geometry_yes_no = BoolSelector(true)  # graph input

# group: Creates Grouting Volumes
grouting_offset = DoubleInput(2)  # graph input
linear_elastic_materila_grouting = IntegerSlider(1, range=0..1 step 1)  # "Linear_elastic_materila_grouting: 0- False; 1- True"; graph input
grouting_volumes = Python(IN[0]=calculation_of_the_adaptive, IN[1]=linig_outer_radius, IN[2]=excavation_radius, IN[3]=lining_level_of_detail_lod1_lod2, IN[4]=grouting_Geometry_yes_no)
# ---------- grouting_volumes.python (78 lines) ----------
import clr
import math
import sys
pyt_path = r'C:\Program Files (x86)\IronPython 2.7\Lib'
sys.path.append(pyt_path)
clr.AddReference('ProtoGeometry')
from Autodesk.DesignScript.Geometry import *
#The inputs to this node will be stored as a list in the IN variables.
dataEnteringNode = IN
import System
#a=Point.ByCoordinates(IN[0],IN[0],IN[0])

list_points=[]
list_or=[]
list_directors=[]
list_vectors=[]
list_circle_in=[]
list_volumes_in=[]
list_circle_out=[]
list_volumes_out=[]
grouting_solids=[]
list_addap_points=IN[0]
lining_outer_radius=IN[1]
exc_radius=IN[2]
lining_lod=IN[3]
cross_sections=[0]*2
dir_points=[0]*2
dec=IN[4]

if (	 lining_lod!=0 and lining_lod!=1 and dec == True):
#if (	lining_lod!=1 and lining_lod!=0 and dec == True):

	for i in range(0, len(list_addap_points)/2+1):
		list_points.append(list_addap_points[i*2])
		
	#create list of vectors and measure angle
	
	for i in range (1, len(list_points)):
		v=Vector.ByTwoPoints(list_points[i-1],list_points[i] )
		list_vectors.append(v)
	list_vectors.append(list_vectors[len(list_vectors)-1])
		
	for i in range (1, len(list_vectors)):	
		circle=Circle.ByCenterPointRadiusNormal(list_points[i], exc_radius, list_vectors[i])
		list_circle_out.append(circle)
	for i in range (1, len(list_vectors)):	
		circle=Circle.ByCenterPointRadiusNormal(list_points[i], lining_outer_radius, list_vectors[i])
		list_circle_in.append(circle)
		
	
	
	#Guide curve	
	curve=PolyCurve.ByPoints(list_points)
	for i in range (2, len(list_points)):
		dir_points[0]=list_points[i-1]
		dir_points[1]=list_points[i]
		cur=PolyCurve.ByPoints(dir_points)
		#cur=PolyCurve.ByPoints(dir_points)
		list_directors.append(cur)
	for i in range (1, len(list_circle_out)):
		cross_sections[0]=list_circle_out[i-1]
		cross_sections[1]=list_circle_out[i]
		volume= Solid.ByLoft(cross_sections, list_directors[i-1])
		list_volumes_out.append(volume)
	for i in range (1, len(list_circle_in)):
		cross_sections[0]=list_circle_in[i-1]
		cross_sections[1]=list_circle_in[i]
		volume= Solid.ByLoft(cross_sections, list_directors[i-1])
		list_volumes_in.append(volume)
		
	for i in range (0, len(list_volumes_in)):
		grout=Solid.Difference(list_volumes_out[i], list_volumes_in[i])
		grouting_solids.append(grout)
	OUT=grouting_solids
else:
	OUT=0
#OUT=grouting_solids
	print("no grout")
# ----------------------------------------
byGeometry = ImportInstance.ByGeometry(geometry=grouting_volumes)

# group: Creates TBM geometry for selected LOD
insert_point_and_rotation_of_tbm = Python(IN[0]=calculation_of_the_adaptive, IN[1]=grouting_offset, IN[2]=TBM_lenght, IN[3]=ring_lenght)
# ---------- insert_point_and_rotation_of_tbm.python (46 lines) ----------
import clr
import math
clr.AddReference('ProtoGeometry')
from Autodesk.DesignScript.Geometry import *
#The inputs to this node will be stored as a list in the IN variables.
dataEnteringNode = IN
point0=Point.ByCoordinates(0,0,0)
point01=Point.ByCoordinates(1,0,0)


list=IN[0]
grout_offset=IN[1]
tbm_l=IN[2]
ring_l=IN[3]
#r=tbm_l/ring_l
r=math.floor(tbm_l/ring_l)

#STAYS A QUESTION IF TBM OFFSET SHOULD BE +1 OR NOT. i WOTE FOR WITHOUD
tbm_offset=int(r+grout_offset)

strat_point_index=grout_offset*2+2

end_point_index=tbm_offset*2+2


start=[]
#insert point of tbm
strat_point=list[strat_point_index]
start.append(strat_point)

point1=strat_point
point2=list[strat_point_index+1]


vector1=Vector.ByTwoPoints(point0, point01)
vector2=Vector.ByTwoPoints(point1, point2)
angle=vector1.AngleWithVector(vector2)

#Assign your output to the OUT variable.
if point2.Y>point1.Y:
	angle=90-angle
else:
	angle=90+angle
	
start.append(angle)
OUT = start
# ----------------------------------------
python_script = Python(IN[0]=insert_point_and_rotation_of_tbm, IN[2]=tbm_level_of_detail_lod1_lod2, IN[3]=TBM_lenght, IN[4]=TBM_radus, IN[5]=tbm_conicity, IN[6]=tbm_shield_thickness, IN[7]=tbm_wall_distance, IN[8]=tbm_wall_thickness, IN[9]=lining_rings_under_shield, IN[10]=family_types, IN[11]=family_types_2, IN[12]=family_types_3, IN[13]=family_types_4, IN[14]=linig_ring_length, IN[15]=number_of_segments, IN[16]=r_hydraulic_jacks)  # unwired: IN[1]
# ---------- python_script.python (156 lines) ----------
import clr
import math


clr.AddReference('ProtoGeometry')
clr.AddReference("RevitNodes")
from Autodesk.DesignScript.Geometry import *
#The inputs to this node will be stored as a list in the IN variables.
dataEnteringNode = IN
import Revit
clr.ImportExtensions(Revit.Elements)

#Assign your output to the OUT variable.
start_point=IN[0][0]
rotation=IN[0][1]
theta=rotation*math.pi/180
LOD=IN[2]
TBM_length=IN[3]
TBM_radius=IN[4]
TBM_conicity=IN[5]
TBM_shield_thickness=IN[6]
TBM_wall_distance=IN[7]
TBM_wall_thickness=IN[8]
linig_rings_under_TBM=IN[9]
TBM_lod_1=IN[10]
TBM_lod_2=IN[11]
TBM_lod_3=IN[12]
hydraulic_jacks=IN[13]
ring_lenght=IN[14]
n_segments=IN[15]
r_jacks=IN[16]
if n_segments==7:
	beta=30



#family_column=Revit.Elements.Element.SetParameterByName(family_column, 'b', (a_column))
#family_column=Revit.Elements.Element.SetParameterByName(family_column, 'a', (b_column))
#family_floor=Revit.Elements.Element.SetParameterByName(family_floor, 'h_floor', (floor_thick))
#floor_params=[['a1','a2', 'a3', 'a4'], ['b1', 'b2', 'b3', 'b4']]



x0=start_point.X
y0=start_point.Y
#x0=(start_point.X*math.cos(theta)+start_point.Y*math.sin(theta))
#y0=(-start_point.X*math.sin(theta)+start_point.Y*math.cos(theta))
z0=start_point.Z
all=[]

points=[]



if LOD==1:
	coor_x= x0
	coor_y=y0
	coor_z= z0
	point=Point.ByCoordinates(coor_x, coor_y, coor_z)

	TBM=Revit.Elements.FamilyInstance.ByPoint(TBM_lod_1,point)
	TBM=Revit.Elements.FamilyInstance.SetRotation(TBM, rotation)
	TBM=Revit.Elements.Element.SetParameterByName(TBM, 'TBM_length', (TBM_length))
	TBM=Revit.Elements.Element.SetParameterByName(TBM, 'TBM_r', (TBM_radius))
	TBM=Revit.Elements.Element.SetParameterByName(TBM, 'Conicity', (TBM_conicity))

	all.append(TBM)

elif(LOD==2):
	coor_x= x0
	coor_y=y0
	coor_z= z0
	point=Point.ByCoordinates(coor_x, coor_y, coor_z)

	TBM=Revit.Elements.FamilyInstance.ByPoint(TBM_lod_2,point)
	TBM=Revit.Elements.FamilyInstance.SetRotation(TBM, rotation)
	TBM=Revit.Elements.Element.SetParameterByName(TBM, 'TBM_length', (TBM_length))
	TBM=Revit.Elements.Element.SetParameterByName(TBM, 'TBM_r', (TBM_radius))
	TBM=Revit.Elements.Element.SetParameterByName(TBM, 'Conicity', (TBM_conicity))
	TBM=Revit.Elements.Element.SetParameterByName(TBM, 'shield_thick', (TBM_shield_thickness))

	all.append(TBM)
elif(LOD==3):
	coor_x= x0
	coor_y=y0
	coor_z= z0
	point=Point.ByCoordinates(coor_x, coor_y, coor_z)

	TBM=Revit.Elements.FamilyInstance.ByPoint(TBM_lod_3,point)
	TBM=Revit.Elements.FamilyInstance.SetRotation(TBM, rotation)
	TBM=Revit.Elements.Element.SetParameterByName(TBM, 'TBM_length', (TBM_length))
	TBM=Revit.Elements.Element.SetParameterByName(TBM, 'TBM_r', (TBM_radius))
	TBM=Revit.Elements.Element.SetParameterByName(TBM, 'Conicity', (TBM_conicity))
	TBM=Revit.Elements.Element.SetParameterByName(TBM, 'shield_thick', (TBM_shield_thickness))
	TBM=Revit.Elements.Element.SetParameterByName(TBM, 'wall_distance_front', (TBM_wall_distance))
	TBM=Revit.Elements.Element.SetParameterByName(TBM, 'TBM_wall_thickness', (TBM_wall_thickness))

	all.append(TBM)
	list_points_orign=[]
	jacks_all=[]
	for i in range (0,360/beta):
		for j in range (1,3):
			radius=TBM_radius-TBM_shield_thickness-(TBM_length*math.sin(TBM_conicity*math.pi/180.00))
			x=x0+radius*math.cos((beta*i+(7.5*math.pow(-1,j)))*math.pi/180.00)

		#x=x0+(TBM_radius-TBM_shield_thickness-500)*math.cos((30*i)*math.pi/180.00)

			y=y0+linig_rings_under_TBM*ring_lenght
			z=z0+radius*math.sin((beta*i+(7.5*math.pow(-1,j)))*math.pi/180.00)
			point=Point.ByCoordinates(x, y, z)
			list_points_orign.append(point)
	all_x=0
	all_y=0
	for i in range (0, len(list_points_orign)):
		all_x=all_x+list_points_orign[i].X
		all_y=all_y+list_points_orign[i].Y
	x_average=all_x/len(list_points_orign)
	y_average=all_y/len(list_points_orign)
	#for i in range (0,360/beta):
	#	for j in range (1,3):
	for i in range (0, len(list_points_orign)):
		x=list_points_orign[i].X
		y=list_points_orign[i].Y
		Z=list_points_orign[i].Z
		x1=x-x0
		y1=y-y0
		#x1=(x*math.cos(theta)+y*math.sin(theta))+x_average
		#y1=(-x*math.sin(theta)+y*math.cos(theta))+y_average
		z1=list_points_orign[i].Z
		#z=z0+(TBM_radius-TBM_shield_thickness-500)*math.sin((30*i)*math.pi/180.00)
		x2=(x1*math.cos(theta)+y1*math.sin(theta))
		y2=(-x1*math.sin(theta)+y1*math.cos(theta))
		x2=x2+x0
		y2=y2+y0
		z2=list_points_orign[i].Z
		point=Point.ByCoordinates(x1, y1, z1)
		point=Point.ByCoordinates(x2, y2, z2)
			#point=Point.ByCoordinates(x, y, z)
		#list_points.append(point)
		jack=Revit.Elements.FamilyInstance.ByPoint(hydraulic_jacks,point)
		jack=Revit.Elements.Element.SetParameterByName(jack, 'l_jacks', (TBM_length-TBM_wall_distance-TBM_wall_thickness-linig_rings_under_TBM*ring_lenght))		
		jack=Revit.Elements.Element.SetParameterByName(jack, 'r_jacks', (r_jacks))		
		jack=Revit.Elements.FamilyInstance.SetRotation(jack, rotation)
		jacks_all.append(jack)
	
	
		all.append(jack)
else:
	all=0
points.append(start_point)
points.append(point)
OUT = all
#OUT = jacks_all
#OUT = list_points
#OUT = points
#OUT = columns
# ----------------------------------------

# group: Converts Family instance to geometry
geometry = Element.Geometry(element=python_script)
flatten_2 = List.Flatten(list=geometry)

family_types_5 = FamilyTypes(index=12)  # graph input
code_block = CodeBlock(a=lining_level_of_detail_lod1_lod2) { b=a-1; }

# group: Familaies Linig Lod 1 2 3
family_types_6 = FamilyTypes(index=15)  # graph input
family_types_7 = FamilyTypes(index=14)  # graph input
family_types_8 = FamilyTypes(index=143)  # graph input
family_types_9 = FamilyTypes(index=85)  # graph input
family_types_10 = FamilyTypes(index=87)  # graph input
family_types_11 = FamilyTypes(index=3)  # graph input
family_types_12 = FamilyTypes(index=5)  # graph input
family_types_13 = FamilyTypes(index=9)  # graph input
family_types_14 = FamilyTypes(index=11)  # graph input
list_of_segments = List.Create(item0=family_types_8, item1=family_types_9, item2=family_types_10, item3=family_types_11, item4=family_types_12, item5=family_types_13, item6=family_types_14, item7=family_types_5)
create_3 = List.Create(item0=family_types_6, item1=family_types_7, item2=list_of_segments)
getItemAtIndex = List.GetItemAtIndex(list=create_3, index=code_block)
string = StringInput("inner_r")  # graph input
setParameterByName = Element.SetParameterByName(element=getItemAtIndex, parameterName=string, value=lining_inner_radius)
string_2 = StringInput("outer_r")  # graph input
setParameterByName_2 = Element.SetParameterByName(element=getItemAtIndex, parameterName=string_2, value=linig_outer_radius)

# group: Creates Lining Family Instances for selected LOD
coordinates_of_the_adaptive = Python(IN[0]=calculation_of_the_adaptive)  # "Coordinates of the adaptive families"
# ---------- coordinates_of_the_adaptive.python (16 lines) ----------
import clr
clr.AddReference('ProtoGeometry')
from Autodesk.DesignScript.Geometry import *
#The inputs to this node will be stored as a list in the IN variables.
dataEnteringNode = IN

#Assign your output to the OUT variable.


Matrix = [[0 for x in range(3)] for y in range((len(IN[0])-3)/2)] 

for i in range (0, (len(IN[0])-3)/2):
	Matrix [i][0]=IN[0][(i+1)*2]
	Matrix [i][1]=IN[0][(i+1)*2+1]
	Matrix [i][2]=IN[0][(i+1)*2+2]
OUT = Matrix
# ----------------------------------------
linig_ring_family_instances = AdaptiveComponent.ByPoints(points=coordinates_of_the_adaptive, familyType=getItemAtIndex)

flatten_3 = List.Flatten(list=linig_ring_family_instances)
geometry_2 = Element.Geometry(element=flatten_3)
flatten_4 = List.Flatten(list=geometry_2)

# group (continued): Creates Lining Family Instances for selected LOD
python_script_2 = Python(IN[0]=flatten_4)
# ---------- python_script_2.python (13 lines) ----------
import clr
clr.AddReference('ProtoGeometry')
from Autodesk.DesignScript.Geometry import *
#The inputs to this node will be stored as a list in the IN variables.
dataEnteringNode = IN

list=[]
for i in range (0, len(IN[0])):
	if (str(IN[0][i])== 'Solid') or (str(IN[0][i])== 'Surface'):
		list.append (IN[0][i])

#Assign your output to the OUT variable.
OUT = list
# ----------------------------------------

# group: Builing Familes at different LODs
family_types_15 = FamilyTypes(index=135)  # graph input
family_types_16 = FamilyTypes(index=131)  # graph input
family_types_17 = FamilyTypes(index=145)  # graph input
family_types_18 = FamilyTypes(index=146)  # graph input
family_types_19 = FamilyTypes(index=137)  # graph input

# group: Metamodel parameters
overburden = DoubleInput(1500)  # graph input
alignemt_solution = DoubleSlider(5, range=1..5 step 1)  # graph input

levels = Levels(index=1)  # graph input
elevation = Level.Elevation(level=levels)
code_block_2 = CodeBlock(a=overburden, b=elevation) { a+b-100; }
rotation_building = DoubleSlider(90, range=0..360 step 1)  # graph input
building_Geometry_yes_no = BoolSelector(true)  # graph input

# group: Creates building for selected LOD
number_2 = DoubleInput(15900)  # graph input
number_3 = DoubleInput(7000)  # graph input
number_4 = DoubleInput(7500)  # graph input
insert_point_building = Point.ByCoordinates(x=number_3, y=number_4, z=code_block_2)
python_script_3 = Python(IN[0]=num_of_columns_x, IN[1]=num_of_columns_Y, IN[2]=x_span, IN[3]=y_span, IN[4]=number_of_floors, IN[5]=floor_height, IN[6]=floor_thickness, IN[7]=family_types_15, IN[8]=family_types_16, IN[9]=columns_a, IN[10]=columns_b, IN[11]=insert_point_building, IN[12]=rotation_building, IN[13]=family_types_17, IN[14]=family_types_18, IN[15]=building_level_of_detail_lod1, IN[16]=family_types_19, IN[17]=model_path, IN[18]=building_Geometry_yes_no)
# ---------- python_script_3.python (265 lines) ----------
import clr
import sys
import math
#import math
#import sys
pyt_path = r'C:\Program Files (x86)\IronPython 2.7\Lib'
sys.path.append(pyt_path)
import os

clr.AddReference('ProtoGeometry')
clr.AddReference("RevitNodes")
from Autodesk.DesignScript.Geometry import *
#The inputs to this node will be stored as a list in the IN variables.
dataEnteringNode = IN
import Revit
clr.ImportExtensions(Revit.Elements)
LOD=IN[15]

family_build_lod_1=IN[13]
family_build_lod_2=IN[14]

start_point=IN[11]
rotation=IN[12]
theta=rotation*math.pi/180

n_col_x=IN[0]
n_col_y=IN[1]
x_spam=IN[2]
y_spam=IN[3]
n_floors=IN[4]
floor_height=IN[5]
floor_thick=IN[6]
family_column=IN[7]
family_column_top=IN[16]
family_floor=IN[8]
a_column=IN[9]
b_column=IN[10]
columns=[]
floors=[]
path1=IN[17]
dec=IN[18]
path=path1+"sat_files\\buildings\\"

family_column=Revit.Elements.Element.SetParameterByName(family_column, 'b', (a_column))
family_column=Revit.Elements.Element.SetParameterByName(family_column, 'a', (b_column))
family_floor=Revit.Elements.Element.SetParameterByName(family_floor, 'h_floor', (floor_thick))




x0=start_point.X
y0=start_point.Y
#x0=(start_point.X*math.cos(theta)-start_point.Y*math.sin(theta))
#y0=(start_point.X*math.sin(theta)+start_point.Y*math.cos(theta))
z0=start_point.Z
all=[]

Matrix_column = [[[0 for x in range (n_col_y)] for y in range(n_col_x)] for z in range(n_floors+1)]
Matrix_floors = [[[0 for x in range (n_col_y-1)] for y in range(n_col_x-1)] for z in range(n_floors+1)] 

if LOD==0:
	sys.exit()

if LOD==1:
	#coor_x= x_spam*(n_col_x-1)/2 +x0
	#coor_y=y_spam*(n_col_y-1)/2 +y0
	theta=rotation*math.pi/180.0
	coor_x= x0 + (x_spam*(n_col_x-1)/2.0*math.cos(theta) + y_spam*(n_col_y-1)/2.0*math.sin(theta))
	coor_y=y0 +(-x_spam*(n_col_x-1)/2.0*math.sin(theta) + y_spam*(n_col_y-1)/2.0*math.cos(theta))
	coor_z= z0
	point=Point.ByCoordinates(coor_x, coor_y, coor_z)

	build=Revit.Elements.FamilyInstance.ByPoint(family_build_lod_1,point)
	build=Revit.Elements.Element.SetParameterByName(build, 'x_build', (x_spam*(n_col_x-1)))
	build=Revit.Elements.Element.SetParameterByName(build, 'y_build', (y_spam*(n_col_y-1)))
	build=Revit.Elements.FamilyInstance.SetRotation(build, rotation)
	all.append(build)
	
	if not os.path.exists(path):
	    os.makedirs(path)
	
	ifile = open(path+"building.dat", 'a' )
	build=[[-(x_spam*(n_col_x-1)/2.0), -(y_spam*(n_col_y-1)/2.0)],[(x_spam*(n_col_x-1)/2.0), -(y_spam*(n_col_y-1)/2.0)],[(x_spam*(n_col_x-1)/2.0), (y_spam*(n_col_y-1)/2.0)],[-(x_spam*(n_col_x-1)/2.0), (y_spam*(n_col_y-1)/2.0)]]
	#build=[[0.0, 0.0)],[(x_spam*(n_col_x-1)), 0.0],[(x_spam*(n_col_x-1)), (y_spam*(n_col_y-1))],[0.0, (y_spam*(n_col_y-1))]]
	build2=[[0] * 2] * 4
	theta=rotation*math.pi/180.0
	for b in range (0, len(build)):
		build2[b][0]=build[b][0]*math.cos(theta) +build[b][1]*math.sin(theta)+x0+x_spam*(n_col_x-1)/2.0
		build2[b][1]=-build[b][0]*math.sin(theta) +build[b][1]*math.cos(theta)+y0+y_spam*(n_col_y-1)/2.0
		ifile.write(str(build2[b][0])+" "+str(build2[b][1])+"\n")
	ifile.close()
	

elif(LOD==2):
	theta=rotation*math.pi/180.0
	coor_x= x0 + (x_spam*(n_col_x-1)/2.0*math.cos(theta) + y_spam*(n_col_y-1)/2.0*math.sin(theta))
	coor_y=y0 +(-x_spam*(n_col_x-1)/2.0*math.sin(theta) + y_spam*(n_col_y-1)/2.0*math.cos(theta))
	coor_z= z0
	point=Point.ByCoordinates(coor_x, coor_y, coor_z)

	build=Revit.Elements.FamilyInstance.ByPoint(family_build_lod_2,point)
	build=Revit.Elements.Element.SetParameterByName(build, 'x_build', (x_spam*(n_col_x-1)))
	build=Revit.Elements.Element.SetParameterByName(build, 'y_build', (y_spam*(n_col_y-1)))
	build=Revit.Elements.Element.SetParameterByName(build, 'h_build', (n_floors*(floor_height)))
	build=Revit.Elements.FamilyInstance.SetRotation(build, rotation)
	all.append(build)

elif(LOD==3):

	for i in range (0, n_floors):
		for j in range (0, n_col_x):
			for k in range (0, n_col_y):
				coor_x= j*x_spam +x0
				coor_y=k*y_spam +y0
				coor_z= i*floor_height+z0
				#point=Point.ByCoordinates(coor_x, coor_y, coor_z)
				x1=coor_x-x0
				y1=coor_y-y0
				x2=(x1*math.cos(theta)+y1*math.sin(theta))
				y2=(-x1*math.sin(theta)+y1*math.cos(theta))
				x2=x2+x0
				y2=y2+y0
				z2=coor_z
			#point=Point.ByCoordinates(coor_x, coor_y, coor_z)
				point=Point.ByCoordinates(x2, y2, z2)
				Matrix_column[i][j][k]=point
				column=Revit.Elements.FamilyInstance.ByPoint(family_column,point)
				column=Revit.Elements.Element.SetParameterByName(column, 'h1', (floor_thick))
				column=Revit.Elements.Element.SetParameterByName(column, 'h2', (floor_height-floor_thick))
				column=Revit.Elements.FamilyInstance.SetRotation(column, rotation)
				columns.append(column)
	
	
	for j in range (0, n_col_x):
		for k in range (0, n_col_y):
			coor_x= j*x_spam+x0
			coor_y=k*y_spam+y0
			coor_z= n_floors*floor_height+z0
			
			
			x1=coor_x-x0
			y1=coor_y-y0
			x2=(x1*math.cos(theta)+y1*math.sin(theta))
			y2=(-x1*math.sin(theta)+y1*math.cos(theta))
			x2=x2+x0
			y2=y2+y0
			z2=coor_z
			#point=Point.ByCoordinates(coor_x, coor_y, coor_z)
			point=Point.ByCoordinates(x2, y2, z2)
			Matrix_column[n_floors][j][k]=point
			column=Revit.Elements.FamilyInstance.ByPoint(family_column_top,point)
			column=Revit.Elements.Element.SetParameterByName(column, 'h1', (floor_thick))
			column=Revit.Elements.Element.SetParameterByName(column, 'b', (a_column))
			column=Revit.Elements.Element.SetParameterByName(column, 'a', (b_column))
			column=Revit.Elements.FamilyInstance.SetRotation(column, rotation)
			columns.append(column)
	for i in range (0, n_floors+1):
		for j in range (0, n_col_x-1):
			for k in range (0, n_col_y-1):
				coor_x= j*x_spam+x_spam/2+x0
				coor_y=k*y_spam+y_spam/2+y0
				coor_z= i*floor_height+z0
				
				x1=coor_x-x0
				y1=coor_y-y0
				x2=(x1*math.cos(theta)+y1*math.sin(theta))
				y2=(-x1*math.sin(theta)+y1*math.cos(theta))
				x2=x2+x0
				y2=y2+y0
				z2=coor_z
				
				
				
				
				#point=Point.ByCoordinates(coor_x, coor_y, coor_z)
				point=Point.ByCoordinates(x2, y2, z2)
				Matrix_floors[i][j][k]=point
				floor=Revit.Elements.FamilyInstance.ByPoint(family_floor,point)
				floor=Revit.Elements.Element.SetParameterByName(floor, 'x_offset', (x_spam/2-a_column/2))
				floor=Revit.Elements.Element.SetParameterByName(floor, 'y_offset', (y_spam/2-b_column/2))
				if j==0:
					if k==0:	
						floor=Revit.Elements.Element.SetParameterByName(floor, 'dx1', (a_column))
						floor=Revit.Elements.Element.SetParameterByName(floor, 'dx2', (a_column))
						floor=Revit.Elements.Element.SetParameterByName(floor, 'dy1', (b_column))
						floor=Revit.Elements.Element.SetParameterByName(floor, 'dy2', (b_column))

						
					elif k==(n_col_y-2):
	
						floor=Revit.Elements.Element.SetParameterByName(floor, 'dx1', (a_column))
						floor=Revit.Elements.Element.SetParameterByName(floor, 'dx2', (a_column))
						floor=Revit.Elements.Element.SetParameterByName(floor, 'dy1', (b_column))
						floor=Revit.Elements.Element.SetParameterByName(floor, 'dy2', (b_column))

					else:
						
						floor=Revit.Elements.Element.SetParameterByName(floor,'dx1', (a_column))
						floor=Revit.Elements.Element.SetParameterByName(floor, 'dx2', (a_column))
						floor=Revit.Elements.Element.SetParameterByName(floor, 'dy1', (b_column))
						floor=Revit.Elements.Element.SetParameterByName(floor, 'dy2', (b_column/2))
				elif j==	(n_col_x-2):
					if k==0:
						floor=Revit.Elements.Element.SetParameterByName(floor, 'dx1', (a_column))
						floor=Revit.Elements.Element.SetParameterByName(floor, 'dx2', (a_column))
						floor=Revit.Elements.Element.SetParameterByName(floor, 'dy1', (b_column))
						floor=Revit.Elements.Element.SetParameterByName(floor,'dy2', (b_column))
						
						
					elif k==(n_col_y-2):	
						floor=Revit.Elements.Element.SetParameterByName(floor, 'dx1', (a_column))
						floor=Revit.Elements.Element.SetParameterByName(floor, 'dx2', (a_column))
						floor=Revit.Elements.Element.SetParameterByName(floor, 'dy1', (b_column))
						floor=Revit.Elements.Element.SetParameterByName(floor, 'dy2', (b_column))

					else:	
						floor=Revit.Elements.Element.SetParameterByName(floor, 'dx1', (a_column))
						floor=Revit.Elements.Element.SetParameterByName(floor, 'dx2', (a_column))
						floor=Revit.Elements.Element.SetParameterByName(floor, 'dy1', (b_column))
						floor=Revit.Elements.Element.SetParameterByName(floor, 'dy2', (b_column))
	
				elif (k==0	and j!=0 and j!=(n_col_x-2)):
					floor=Revit.Elements.Element.SetParameterByName(floor, 'dx1', (a_column))
					floor=Revit.Elements.Element.SetParameterByName(floor, 'dx2', (a_column))
					floor=Revit.Elements.Element.SetParameterByName(floor, 'dy1', (b_column))
					floor=Revit.Elements.Element.SetParameterByName(floor, 'dy2', (b_column))
					
				elif (k==(n_col_y-2) and j!=0 and j!=(n_col_x-2)):	
					floor=Revit.Elements.Element.SetParameterByName(floor, 'dx1', (a_column))
					floor=Revit.Elements.Element.SetParameterByName(floor, 'dx2', (a_column))
					floor=Revit.Elements.Element.SetParameterByName(floor, 'dy1', (b_column))
					floor=Revit.Elements.Element.SetParameterByName(floor, 'dy2', (b_column))
				else:
					floor=Revit.Elements.Element.SetParameterByName(floor, 'dx1', (a_column))
					floor=Revit.Elements.Element.SetParameterByName(floor, 'dx2', (a_column))
					floor=Revit.Elements.Element.SetParameterByName(floor,'dy1', (b_column))
					floor=Revit.Elements.Element.SetParameterByName(floor, 'dy2', (b_column))
				floor=Revit.Elements.FamilyInstance.SetRotation(floor, (rotation))
				
				
				
	#			for p in range (0, len(floor_params)/2):
	#				floor= Revit.Elements.Element.SetParameterByName(floor, floor_params[p], a_column/2)
	#				floor= Revit.Elements.Element.SetParameterByName(floor, floor_params[len(floor_params)/2+p], b_column/2)
				floors.append(floor)
				
	#family_column=Family_Types(generic_column:generic_column)
	
	for i in range(0, len(columns)):
		all.append(columns[i])
	for i in range(0, len(floors)):
		all.append(floors[i])
		
else:
	all=0

#FamilyInstance.ByPoint

#Assign your output to the OUT variable.
if dec==True:
	OUT = all
else:
	OUT=0
#OUT2 = surfaces
#OUT = columns
# ----------------------------------------

# group: Converts Family instance to geometry
geometry_3 = Element.Geometry(element=python_script_3)
flatten_5 = List.Flatten(list=geometry_3)

# group: Soil model parameters
soil_model_file = StringInput("F:\revit\Tunnel_adaptive_excavation_segments\Sat_soil_geometry.sat")  # graph input
number_5 = DoubleInput(1)  # graph input
getItemAtIndex_2 = List.GetItemAtIndex(list=calculation_of_the_adaptive, index=number_5)
length = Curve.Length(curve=curves)
firstItem = List.FirstItem(list=length)
firstItem_2 = List.FirstItem(list=firstItem)

# group: Material Parameters Soil
material_1_linear_elastic_2_2 = IntegerSlider(1, range=1..3 step 1)  # "Material: 1- Linear Elastic; 2 - DruckerPrager; 3 - CASM"; graph input
young_modulus_2 = DoubleInput(100000000)  # graph input
poisons_ratio_2 = DoubleInput(0.3)  # graph input
density_2 = DoubleInput(2000)  # graph input
frictions_angle = DoubleInput(30)  # graph input
hardening_modulus = DoubleInput(10000000)  # graph input
permeability = DoubleInput(0.001)  # graph input
material_file_name = StringInput("matfile")  # graph input
cohesion = DoubleInput(10000)  # graph input
porosity = DoubleInput(0.2)  # graph input
matfile = Python(IN[0]=model_path, IN[1]=material_1_linear_elastic_2_2, IN[2]=young_modulus_2, IN[3]=poisons_ratio_2, IN[4]=density_2, IN[5]=frictions_angle, IN[6]=hardening_modulus, IN[7]=permeability, IN[8]=excavation_radius, IN[9]=material_file_name, IN[10]=cohesion, IN[11]=porosity, IN[12]=overburden, IN[13]=pointAtSegmentLength, IN[14]=firstItem_2)
# ---------- matfile.python (64 lines) ----------
import clr
import sys
pyt_path = r'C:\Program Files (x86)\IronPython 2.7\Lib'
sys.path.append(pyt_path)
import os
clr.AddReference('ProtoGeometry')
from Autodesk.DesignScript.Geometry import *
#The inputs to this node will be stored as a list in the IN variables.
dataEnteringNode = IN
model_path=IN[0]
matfile_name=IN[9]
material=IN[1]
E=IN[2]
nu=IN[3]
density=IN[4]
phi=IN[5]
hard_E=IN[6]
permeabiulity=IN[7]
cohesion=IN[10]
porosity=IN[11]
exc=IN[8]
overburden=IN[12]
point_0=IN[13][0][0]
curve_len=IN[14]
ofile = open(model_path+str(matfile_name)+".dat", 'w' )
#X=dim.X
#Z=dim.Z

#Assign your output to the OUT variable.


ofile.write("begin material soil_1\n")
ofile.write("begin polygon\n")
#ofile.write (str(point_0.X-dim*2)+ " 0 "+str(point_0.Z-dim*10)+" \n")
#ofile.write(str(point_0.X+curve_len+dim*6)+ " 0 "+str(point_0.Z-dim*10)+" \n")
#ofile.write(str(point_0.X+curve_len+dim*6)+ " 0 "+str(point_0.Z+overburden)+" \n")
#ofile.write(str(point_0.X-dim*10)+ " 0 "+str(point_0.Z+overburden)+" \n")
ofile.write (str(-exc*2/100)+ " 0 "+str(-exc*10/100)+" \n")
ofile.write(str((curve_len+exc*6)/100)+ " 0 "+str(-exc*10/100)+" \n")
ofile.write(str((curve_len+exc*6)/100)+ " 0 "+str(overburden/100)+" \n")
ofile.write(str(-exc*2/100)+ " 0 "+str(overburden/100)+" \n")
ofile.write("end polygon\n")
ofile.write("begin parameters\n")
if material==1:
	ofile.write("model_type isotropic3d \n" )
elif material==2:
	ofile.write("model_type drucker_prager \n" )
else:
	ofile.write("model_type casm \n" )

ofile.write("youngs_modulus "+str(E)+" \n")
ofile.write("internal_friction_angle "+str(phi)+" \n")
ofile.write("hardening_modulus "+str(hard_E)+" \n")
ofile.write("density "+str(density)+" \n")
ofile.write("poisson_ratio "+str(nu)+" \n")
ofile.write("permeability "+str(permeabiulity)+" \n")
ofile.write("porosity "+str(porosity)+" \n")
ofile.write("cohesion "+str(cohesion)+ " \n")
ofile.write("K0 1.0\n")
ofile.write("end parameters\n")
ofile.write("end material\n")

ofile.close()
OUT = point_0
# ----------------------------------------
water_1_false_2_true = IntegerSlider(2, range=1..2 step 1)  # graph input

# group: Input files simulation model
parameter_file_tbm = Python(IN[0]=tbm_level_of_detail_lod1_lod2, IN[1]=model_path, IN[2]=r_hydraulic_jacks, IN[3]=TBM_lenght, IN[4]=tbm_conicity, IN[5]=TBM_radus)
# ---------- parameter_file_tbm.python (40 lines) ----------
import clr
import sys
pyt_path = r'C:\Program Files (x86)\IronPython 2.7\Lib'
sys.path.append(pyt_path)
import os
clr.AddReference('ProtoGeometry')
from Autodesk.DesignScript.Geometry import *
#The inputs to this node will be stored as a list in the IN variables.
dataEnteringNode = IN
Lod_tbm=IN[0]
model_path=IN[1]
r_jacks=IN[2]
tbm_lenght=IN[3]
tbm_conicity=IN[4]
tbm_r=IN[5]


path=model_path+"/input_files/"

if not os.path.exists(path):
    os.makedirs(path)

ifile = open(path+"tbm.dat", 'w' )

#Assign your output to the OUT variable.


ifile.write("lod "+ str(Lod_tbm)+"\n" )

ifile.write("jack_radius "+ str(r_jacks)+"\n" )

ifile.write("tbm_lenght "+ str(tbm_lenght)+"\n" )

ifile.write("tbm_r "+ str(tbm_r)+"\n" )


ifile.write("tbm_conicity "+ str(tbm_conicity)+"\n" )

ifile.close()
OUT = ifile
# ----------------------------------------
parameter_files_soil = Python(IN[0]=soil_level_of_detail_0_1_2, IN[1]=model_path, IN[2]=volume_loss)
# ---------- parameter_files_soil.python (47 lines) ----------
import clr
import sys
pyt_path = r'C:\Program Files (x86)\IronPython 2.7\Lib'
sys.path.append(pyt_path)
import os
clr.AddReference('ProtoGeometry')
from Autodesk.DesignScript.Geometry import *
#The inputs to this node will be stored as a list in the IN variables.
dataEnteringNode = IN
Lod_soil=IN[0]
model_path=IN[1]
volume_loss=IN[2]

path=model_path+"/input_files/"

if not os.path.exists(path):
    os.makedirs(path)

ifile = open(path+"soil.dat", 'w' )

#Assign your output to the OUT variable.


ifile.write("lod "+ str(Lod_soil)+"\n" )
ifile.write("volume_loss "+ str(volume_loss)+"\n" )

ifile.close()

	
ifile = open(path+"excavation.dat", 'w' )
if Lod_soil<1:
	ifile.write("lod 0\n" )
else:
	ifile.write("lod 1\n" )

ifile.close()

ifile = open(path+"insitu.dat", 'w' )

if Lod_soil<1:
	ifile.write("lod 0\n" )
else:
	ifile.write("lod 1\n" )

ifile.close()

OUT = ifile
# ----------------------------------------
parameter_file_building = Python(IN[0]=building_level_of_detail_lod1, IN[1]=num_of_columns_x, IN[2]=num_of_columns_Y, IN[3]=number_of_floors, IN[4]=create_2, IN[5]=model_path, IN[6]=x_span, IN[7]=y_span, IN[8]=floor_height)
# ---------- parameter_file_building.python (46 lines) ----------
import clr
import sys
pyt_path = r'C:\Program Files (x86)\IronPython 2.7\Lib'
sys.path.append(pyt_path)
import os
clr.AddReference('ProtoGeometry')
from Autodesk.DesignScript.Geometry import *
#The inputs to this node will be stored as a list in the IN variables.
dataEnteringNode = IN

Lod_building=IN[0]
n_col_x=IN[1]
n_col_y=IN[2]
n_floors=IN[3]
material_build=IN[4]
model_path=IN[5]
x_span=IN[6]
y_span=IN[7]
h_floor=IN[8]
path=model_path+"/input_files/"

if not os.path.exists(path):
    os.makedirs(path)

ifile = open(path+"building.dat", 'w' )

#Assign your output to the OUT variable.

ifile.write("lod "+ str(Lod_building)+"\n" )
ifile.write("n_col_x "+ str(n_col_x)+"\n" )
ifile.write("n_col_y "+ str(n_col_y)+"\n" )
ifile.write("n_floors "+ str(n_floors)+"\n" )
ifile.write("x_span "+ str(x_span)+"\n" )
ifile.write("y_span "+ str(y_span)+"\n" )
ifile.write("h_floor "+ str(h_floor)+"\n" )
if material_build[0]==1:
	ifile.write("linear_elastic_material_build True \n" )
elif material_build[0]==2:
	ifile.write("plastic_material True \n" )
else:
	ifile.write("damage_material True \n" )
ifile.write("E_build "+ str(material_build[1])+"\n" )
ifile.write("nu_build "+ str(material_build[2])+"\n" )
ifile.write("ro_build "+ str(material_build[3])+"\n" )
ifile.close()
OUT = ifile
# ----------------------------------------
parameter_files_lining = Python(IN[0]=lining_level_of_detail_lod1_lod2, IN[1]=model_path, IN[2]=soil_level_of_detail_0_1_2, IN[3]=linear_elastic_materila_grouting, IN[4]=linig_outer_radius, IN[5]=lining_inner_radius, IN[6]=segment_type, IN[7]=boolean)
# ---------- parameter_files_lining.python (55 lines) ----------
import clr
import sys
pyt_path = r'C:\Program Files (x86)\IronPython 2.7\Lib'
sys.path.append(pyt_path)
import os
clr.AddReference('ProtoGeometry')
from Autodesk.DesignScript.Geometry import *
#The inputs to this node will be stored as a list in the IN variables.
dataEnteringNode = IN
Lod_lining=IN[0]
model_path=IN[1]
Lod_soil=IN[2]
Linear_elsatic_grouting=IN[3]
lining_outer_radius=IN[4]
lining_inner_radius=IN[5]
segment_type=IN[6]
rs=IN[7]
path=model_path+"/input_files/"

if not os.path.exists(path):
    os.makedirs(path)

ifile = open(path+"lining.dat", 'w' )

#Assign your output to the OUT variable.

ifile.write("lod "+ str(Lod_lining)+"\n" )
ifile.write("lining_outer_radius "+ str(lining_outer_radius)+"\n" )
ifile.write("lining_inner_radius "+ str(lining_inner_radius)+"\n" )
ifile.write("segment_type "+str(segment_type)+"\n" )
ifile.write("rs "+str(rs)+"\n" )

ifile = open(path+"grouting.dat", 'w' )

#Assign your output to the OUT variable.

if Lod_lining<2 or Lod_soil<2:

	ifile.write("lod 0\n" )
else:
	ifile.write("lod 1\n" )

if Linear_elsatic_grouting==1:
	ifile.write("elastic_grouting True\n" )
elif Linear_elsatic_grouting==0:
	ifile.write("elastic_grouting False\n" )
else:
	print"no grouting material"
ifile.close()

if Lod_lining==3:
	ifile = open(path+"bolts.dat", 'w' )
	ifile.write("lod 1\n" )
	ifile.close()
OUT = ifile
# ----------------------------------------
parameter_files_main_model = Python(IN[0]=model_path, IN[1]=model_name, IN[2]=ring_lenght, IN[3]=excavation_radius, IN[4]=flatten, IN[5]=lining_rings_under_shield, IN[6]=material_file_name, IN[7]=material_1_linear_elastic_2_2, IN[8]=water_1_false_2_true, IN[9]=grouting_offset, IN[10]=TBM_lenght, IN[11]=overburden, IN[12]=segment_type)
# ---------- parameter_files_main_model.python (69 lines) ----------
import clr
import sys
import math
#import readline
pyt_path = r'C:\Program Files (x86)\IronPython 2.7\Lib'
sys.path.append(pyt_path)
import os
clr.AddReference('ProtoGeometry')
from Autodesk.DesignScript.Geometry import *
#The inputs to this node will be stored as a list in the IN variables.
dataEnteringNode = IN
model_path=IN[0]
model_name=IN[1]
round_length=IN[2]
excavation_radius=IN[3]
number_of_points=IN[4]
lining_offset=IN[5]
matfile=IN[6]
lin_elastic=IN[7]
water=IN[8]
grouting_offset=IN[9]
TBM_l=IN[10]
segment_type=IN[12]
#volume_loss=IN[11]
#LODs=IN[11]
overburden=IN[11]
path=model_path+"/input_files/"
TBM_offset=math.floor(TBM_l/round_length)+grouting_offset
lining_offset=lining_offset+grouting_offset

if not os.path.exists(path):
    os.makedirs(path)

ifile = open(path+"main_model.dat", 'a' )
#lines = ifile.readlines()
#columns = lines[0].split()
#if colimns=="grouting_pressure":#
#	ifile.close()#
#	ifile = open(path+"main_model.dat", 'a' )
#else:
#	print("empty")	

ifile.write("model_path "+ str(model_path)+"\n" )
ifile.write("model_name "+ str(model_name)+"\n" )
#ifile.write("lod_soil "+ str(LODs[0])+"\n" )
#ifile.write("lod_lining "+ str(LODs[1])+"\n" )
#ifile.write("lod_building "+ str(LODs[2])+"\n" )
#ifile.write("lod_tbm "+ str(LODs[3])+"\n" )
ifile.write("matfile "+ str(matfile)+"\n" )
ifile.write("overburden "+ str(overburden)+"\n" )
ifile.write("round_length "+ str(float(round_length))+"\n" )
ifile.write("excavation_radius "+ str(float(excavation_radius))+"\n" )
ifile.write("number_of_slices "+ str(float(len(number_of_points))-2.0)+"\n" )
ifile.write("lining_offset "+ str(lining_offset)+"\n" )
ifile.write("grouting_offset "+ str(grouting_offset)+"\n" )
ifile.write("TBM_offset "+ str(TBM_offset)+"\n" )
if lin_elastic==1:
	ifile.write("linear_elastic_material True \n")	
else:
	ifile.write("linear_elastic_material False \n")
if water==1:
	ifile.write("account_for_water False \n")	
else:
	ifile.write("account_for_water True \n")
ifile.write("segment_type "+str(segment_type)+"\n" )

ifile.close()	
ifile.close()
OUT = 0
# ----------------------------------------

soil_geometry = BoolSelector(true)  # graph input

# group: Creates Excavation Volume
excavation_volumes = Python(IN[0]=calculation_of_the_adaptive, IN[1]=excavation_radius, IN[2]=soil_geometry)
# ---------- excavation_volumes.python (73 lines) ----------
import clr
import math
clr.AddReference('ProtoGeometry')
from Autodesk.DesignScript.Geometry import *
#The inputs to this node will be stored as a list in the IN variables.
dataEnteringNode = IN
#a=Point.ByCoordinates(IN[0],IN[0],IN[0])

list_points=[]
list_or=[]
list_directors=[]
list_vectors=[]
list_circle_in=[]
list_volumes_in=[]
list_circle_out=[]
list_volumes_out=[]
grouting_solids=[]
list_addap_points=IN[0]
exc_radius=IN[1]
cross_sections=[0]*2
dir_points=[0]*2
dec=IN[2]


	
	
for i in range(0, len(list_addap_points)/2+1):
	list_points.append(list_addap_points[i*2])
	
#create list of vectors and measure angle
point1=list_points[0]
point2=list_points[1]
delta_x=point2.X-point1.X
delta_y=point2.Y-point1.Y
x_new=point1.X-delta_x
y_new=point1.Y-delta_y
z_new=point1.Z
new_point=Point.ByCoordinates(x_new, y_new, z_new)
list_points[0]=new_point

for i in range (1, len(list_points)):
	v=Vector.ByTwoPoints(list_points[i-1],list_points[i] )
	list_vectors.append(v)
list_vectors.append(list_vectors[len(list_vectors)-1])
	
for i in range (0, len(list_vectors)):	
	circle=Circle.ByCenterPointRadiusNormal(list_points[i], exc_radius, list_vectors[i])
	list_circle_out.append(circle)
	


#Guide curve	
curve=PolyCurve.ByPoints(list_points)
for i in range (1, len(list_points)):
	dir_points[0]=list_points[i-1]
	dir_points[1]=list_points[i]
	cur=PolyCurve.ByPoints(dir_points)
	#cur=PolyCurve.ByPoints(dir_points)
	list_directors.append(cur)
for i in range (1, len(list_circle_out)):
	cross_sections[0]=list_circle_out[i-1]
	cross_sections[1]=list_circle_out[i]
	volume= Solid.ByLoft(cross_sections, list_directors[i-1])
	list_volumes_out.append(volume)



#OUT=list_volumes_out
if dec == True:
	OUT = list_volumes_out
else:
	OUT=0
#OUT=
# ----------------------------------------
byGeometry_2 = ImportInstance.ByGeometry()  # unwired: geometry

# group: Creates Soil Volume
python_script_4 = Python(IN[0]=soil_level_of_detail_0_1_2, IN[1]=soil_model_file, IN[2]=excavation_radius, IN[3]=overburden, IN[4]=getItemAtIndex_2, IN[5]=matfile, IN[6]=firstItem_2, IN[7]=soil_geometry)
# ---------- python_script_4.python (51 lines) ----------
import clr
import sys
import math


clr.AddReference('ProtoGeometry')
clr.AddReference("RevitNodes")
from Autodesk.DesignScript.Geometry import *
#The inputs to this node will be stored as a list in the IN variables.
dataEnteringNode = IN
import Revit
clr.ImportExtensions(Revit.Elements)
#The inputs to this node will be stored as a list in the IN variables.
dataEnteringNode = IN
#import Revit
#clr.ImportExtensions(Revit.Elements)
Lod_soil=IN[0]
soil_geom=IN[1]
exc_radius=IN[2]
overburden=IN[3]
insert_point=IN[4]
matfile=IN[5]
curve_len=IN[6]
dec=IN[7]

#The inputs to this node will be stored as a list in the IN variables.
#dataEnteringNode = IN

#
#importinstance1 = Revit.Geometry.ImportInstance.BySATFile(str(soil_geom))
if Lod_soil==0:
	soil=0
	sys.exit
	
elif Lod_soil==1:
	soil=matfile
	sys.exit
elif Lod_soil==2:
	soil= Cuboid.ByLengths(insert_point, curve_len+exc_radius*5, exc_radius*25, exc_radius*10+overburden)
	soil=soil.Translate(curve_len/2+exc_radius*2.5+125.0, 0,-(exc_radius*5-overburden/2))
else:	
	soil = Revit.Elements.ImportInstance.BySATFile(str(soil_geom))

	soil=soil.Geometry()
	soil=soil[0]
	soil=soil.Translate(curve_len/2+exc_radius*2.5, 0,-(exc_radius*5-overburden/2))
#Assign your output to the OUT variable.
if dec == True:
	OUT = soil
else:
	OUT=0
# ----------------------------------------
soil_volume_with_excavation = Solid.DifferenceAll(solid=python_script_4, others=excavation_volumes)
byGeometry_3 = ImportInstance.ByGeometry(geometry=soil_volume_with_excavation)

# group: Export ASCI Geometry
code_block_3 = CodeBlock(a=model_path) { c=a+"sat_files\\TBM"; }
boolean_2 = BoolSelector(true)  # graph input
python_script_5 = Python(IN[0]=flatten_2, IN[1]=code_block_3, IN[2]=boolean_2)
# ---------- python_script_5.python (43 lines) ----------
import clr
import sys
#import os
#import shell
import math
import sys
pyt_path = r'C:\Program Files (x86)\IronPython 2.7\Lib'
sys.path.append(pyt_path)
import os
clr.AddReference('ProtoGeometry')
clr.AddReference("RevitNodes")
from Autodesk.DesignScript.Geometry import *
#import RevitServices
#from RevitServices.Persistence import DocumentManager

import Revit
# Import Revit elements
from Revit.Elements import *
import System
#The inputs to this node will be stored as a list in the IN variables.
dataEnteringNode = IN
tbm=IN[0]
path=IN[1]
dec=IN[2]
#newpath = r'C:\Program Files\arbitrary' 
if not os.path.exists(path):
    os.makedirs(path)
name="\TBM_"

list_tbm_files=[]
for i in range (0, len(tbm)):
	file_name=str(str(path)+str(name)+str(i))
	file = Geometry.ExportToSAT(tbm[i], str(file_name))
	list_tbm_files.append(file)

#Assign your output to the OUT variable.
#OUT = list_tbm_files

if dec==True:
	OUT = list_tbm_files
else:
	OUT =0
#OUT=file_name
# ----------------------------------------
code_block_4 = CodeBlock(a=model_path) { c=a+"sat_files\\grouting"; }
python_script_6 = Python(IN[0]=grouting_volumes, IN[1]=code_block_4, IN[2]=boolean_2)
# ---------- python_script_6.python (41 lines) ----------
import clr
import sys
#import os
#import shell
import math
import sys
pyt_path = r'C:\Program Files (x86)\IronPython 2.7\Lib'
sys.path.append(pyt_path)
import os
clr.AddReference('ProtoGeometry')
clr.AddReference("RevitNodes")
from Autodesk.DesignScript.Geometry import *
#import RevitServices
#from RevitServices.Persistence import DocumentManager

import Revit
# Import Revit elements
from Revit.Elements import *
import System
#The inputs to this node will be stored as a list in the IN variables.
dataEnteringNode = IN
exc_vol=IN[0]
path=IN[1]
dec=IN[2]
#newpath = r'C:\Program Files\arbitrary' 
if not os.path.exists(path):
    os.makedirs(path)
name="\grouting_volume_"

list_soil_files=[]
for i in range (0, len(exc_vol)):
	file_name=str(str(path)+str(name)+str(i+1))
	file = Geometry.ExportToSAT(exc_vol[i], str(file_name))
	list_soil_files.append(file)

#Assign your output to the OUT variable.
if dec==True:
	OUT = list_soil_files
else:
	OUT=0
#OUT=file_name
# ----------------------------------------
code_block_5 = CodeBlock(a=model_path) { c=a+"sat_files\\lining"; }
python_script_7 = Python(IN[0]=python_script_2, IN[1]=code_block_5, IN[2]=boolean_2)
# ---------- python_script_7.python (42 lines) ----------
import clr
import sys
#import os
#import shell
import math
import sys
pyt_path = r'C:\Program Files (x86)\IronPython 2.7\Lib'
sys.path.append(pyt_path)
import os
clr.AddReference('ProtoGeometry')
clr.AddReference("RevitNodes")
from Autodesk.DesignScript.Geometry import *
#import RevitServices
#from RevitServices.Persistence import DocumentManager

import Revit
# Import Revit elements
from Revit.Elements import *
import System
#The inputs to this node will be stored as a list in the IN variables.
dataEnteringNode = IN
exc_vol=IN[0]
path=IN[1]
dec=IN[2]
#newpath = r'C:\Program Files\arbitrary' 
if not os.path.exists(path):
    os.makedirs(path)
name="\lining_volume_"

list_soil_files=[]
for i in range (0, len(exc_vol)):
	file_name=str(str(path)+str(name)+str(i+1))
	file = Geometry.ExportToSAT(exc_vol[i], str(file_name))
	list_soil_files.append(file)

#Assign your output to the OUT variable.
if dec == True:

	OUT = list_soil_files
else:
	OUT=0
#OUT=file_name
# ----------------------------------------
code_block_6 = CodeBlock(a=model_path) { c=a+"sat_files\\buildings"; }
python_script_8 = Python(IN[0]=flatten_5, IN[1]=code_block_6, IN[2]=boolean_2)
# ---------- python_script_8.python (42 lines) ----------
import clr
import sys
#import os
#import shell
import math
import sys
pyt_path = r'C:\Program Files (x86)\IronPython 2.7\Lib'
sys.path.append(pyt_path)
import os
clr.AddReference('ProtoGeometry')
clr.AddReference("RevitNodes")
from Autodesk.DesignScript.Geometry import *
#import RevitServices
#from RevitServices.Persistence import DocumentManager

import Revit
# Import Revit elements
from Revit.Elements import *
import System
#The inputs to this node will be stored as a list in the IN variables.
dataEnteringNode = IN
build_vol=IN[0]
path=IN[1]
dec=IN[2]
#newpath = r'C:\Program Files\arbitrary' 
if not os.path.exists(path):
    os.makedirs(path)
name="\\building_volume"

list_soil_files=[]
list_soil_files=[]
for i in range (0, len(build_vol)):
	file_name=str(str(path)+str(name)+str(i+1))
	file = Geometry.ExportToSAT(build_vol[i], str(file_name))
	list_soil_files.append(file)
#Assign your output to the OUT variable.
#OUT = list_soil_files
if dec==True:
	OUT = list_soil_files
else:
	OUT =0
#OUT=file_name
# ----------------------------------------
code_block_7 = CodeBlock(a=model_path) { c=a+"sat_files\\soil_insitu"; }
python_script_9 = Python(IN[0]=python_script_4, IN[1]=code_block_7, IN[2]=boolean_2)
# ---------- python_script_9.python (42 lines) ----------
import clr
import sys
#import os
#import shell
import math
import sys
pyt_path = r'C:\Program Files (x86)\IronPython 2.7\Lib'
sys.path.append(pyt_path)
import os
clr.AddReference('ProtoGeometry')
clr.AddReference("RevitNodes")
from Autodesk.DesignScript.Geometry import *
#import RevitServices
#from RevitServices.Persistence import DocumentManager

import Revit
# Import Revit elements
from Revit.Elements import *
import System
#The inputs to this node will be stored as a list in the IN variables.
dataEnteringNode = IN
exc_vol=IN[0]
path=IN[1]
dec=IN[2]
#newpath = r'C:\Program Files\arbitrary' 
if not os.path.exists(path):
    os.makedirs(path)
name="\soil_insitu_volume"

list_soil_files=[]

file_name=str(str(path)+str(name))
file = Geometry.ExportToSAT(exc_vol, str(file_name))
list_soil_files.append(file)

#Assign your output to the OUT variable.
#OUT = list_soil_files
if dec==True:
	OUT = list_soil_files
else:
	OUT =0
#OUT=file_name
# ----------------------------------------
code_block_8 = CodeBlock(a=model_path) { c=a+"sat_files\\excavation_soil"; }
python_script_10 = Python(IN[0]=soil_volume_with_excavation, IN[1]=code_block_8, IN[2]=boolean_2)
# ---------- python_script_10.python (41 lines) ----------
import clr
import sys
#import os
#import shell
import math
import sys
pyt_path = r'C:\Program Files (x86)\IronPython 2.7\Lib'
sys.path.append(pyt_path)
import os
clr.AddReference('ProtoGeometry')
clr.AddReference("RevitNodes")
from Autodesk.DesignScript.Geometry import *
#import RevitServices
#from RevitServices.Persistence import DocumentManager

import Revit
# Import Revit elements
from Revit.Elements import *
import System
#The inputs to this node will be stored as a list in the IN variables.
dataEnteringNode = IN
exc_vol=IN[0]
path=IN[1]
dec=IN[2]
#newpath = r'C:\Program Files\arbitrary' 
if not os.path.exists(path):
    os.makedirs(path)
name="\excavation_soil_volume"

list_soil_files=[]
file_name=str(str(path)+str(name))
file = Geometry.ExportToSAT(exc_vol, str(file_name))
list_soil_files.append(file)

#Assign your output to the OUT variable.
if dec == True:

	OUT = list_soil_files
else:
	OUT = 0
#OUT=file_name
# ----------------------------------------
code_block_9 = CodeBlock(a=model_path) { c=a+"sat_files\\excavation"; }
python_script_11 = Python(IN[0]=excavation_volumes, IN[1]=code_block_9, IN[2]=boolean_2)
# ---------- python_script_11.python (41 lines) ----------
import clr
import sys
#import os
#import shell
import math
import sys
pyt_path = r'C:\Program Files (x86)\IronPython 2.7\Lib'
sys.path.append(pyt_path)
import os
clr.AddReference('ProtoGeometry')
clr.AddReference("RevitNodes")
from Autodesk.DesignScript.Geometry import *
#import RevitServices
#from RevitServices.Persistence import DocumentManager

import Revit
# Import Revit elements
from Revit.Elements import *
import System
#The inputs to this node will be stored as a list in the IN variables.
dataEnteringNode = IN
exc_vol=IN[0]
path=IN[1]
dec=IN[2]
#newpath = r'C:\Program Files\arbitrary' 
if not os.path.exists(path):
    os.makedirs(path)
name="\excavation_volume_"

list_soil_files=[]
for i in range (0, len(exc_vol)):
	file_name=str(str(path)+str(name)+str(i))
	file = Geometry.ExportToSAT(exc_vol[i], str(file_name))
	list_soil_files.append(file)

#Assign your output to the OUT variable.
if dec==True:
	OUT = list_soil_files
else:
	OUT =0
#OUT=file_name
# ----------------------------------------

# group: Create alignment file
alignment_file = Python(IN[0]=calculation_of_the_adaptive, IN[1]=model_path, IN[2]=model_name)
# ---------- alignment_file.python (29 lines) ----------
import clr
import sys
pyt_path = r'C:\Program Files (x86)\IronPython 2.7\Lib'
sys.path.append(pyt_path)
import os
clr.AddReference('ProtoGeometry')
from Autodesk.DesignScript.Geometry import *
#The inputs to this node will be stored as a list in the IN variables.
dataEnteringNode = IN
points_alignment=IN[0]
model_path=IN[1]
model_name=IN[2]
path=model_path+"input_files/"

if not os.path.exists(path):
    os.makedirs(path)

ifile = open(path+"alignment.dat", 'w' )

for i in range (0, len(points_alignment)/2):
	point= points_alignment[i*2+1]
	X=point.X
	Y=point.Y
	Z=point.Z
	ifile.write(str(i)+" "+ str(X)+" "+str(Y)+" "+str(Z)+"\n" )

ifile.close()

OUT = ifile
# ----------------------------------------

steps_per_down_time = DoubleInput(1)  # graph input

# group: Semantic data
semantic_data_file_name = StringInput("semantic_data")  # graph input
contsant_perssures_in_time_0 = IntegerSlider(1, range=0..1 step 1)  # "Contsant perssures in time: 0-False; 1-True"; graph input
grouting_pressure = DoubleInput(200000)  # graph input
grouting_pressure_gradient = DoubleInput(10000)  # graph input
face__support_pressure = DoubleInput(180000)  # graph input
face__support_pressure_gradient = DoubleInput(15000)  # graph input
advance_time_per_ring = DoubleInput(1200)  # graph input
advance_time_TBM = DoubleInput(1000)  # graph input
TBM_advance_steps_per_ring = DoubleInput(1)  # graph input
write_output_0_false_1_true = IntegerSlider(1, range=0..1 step 1)  # graph input
grouting_pressures = StringInput("F:/git-satbim_internal/Examples/grouting.dat")  # graph input
face_support_pressures = StringInput("F:/git-satbim_internal/Examples/face_support.dat")  # graph input
semantic_data = Python(IN[0]=model_path, IN[1]=model_name, IN[2]=semantic_data_file_name, IN[3]=contsant_perssures_in_time_0, IN[4]=grouting_pressure, IN[5]=grouting_pressure_gradient, IN[6]=face__support_pressure, IN[7]=face__support_pressure_gradient, IN[8]=advance_time_per_ring, IN[9]=advance_time_TBM, IN[10]=TBM_advance_steps_per_ring, IN[11]=write_output_0_false_1_true, IN[12]=grouting_pressures, IN[13]=face_support_pressures, IN[14]=steps_per_down_time)
# ---------- semantic_data.python (54 lines) ----------
import clr
import sys
pyt_path = r'C:\Program Files (x86)\IronPython 2.7\Lib'
sys.path.append(pyt_path)
import os
clr.AddReference('ProtoGeometry')
from Autodesk.DesignScript.Geometry import *
#The inputs to this node will be stored as a list in the IN variables.
dataEnteringNode = IN
model_path=IN[0]
model_name=IN[1]
file_name=IN[2]
const_pressures=IN[3]
GP=IN[4]
GP_g=IN[5]
SP=IN[6]
SP_g=IN[7]
time_advance_ring=IN[8]
time_advance_TBM=IN[9]
advance_step_per_ring=IN[10]
write_output=IN[11]
file_GP=IN[12]
file_SP=IN[13]
steps_per_down_time=IN[14]

#ofile = open(model_path+"/"+str(model_name)+"/"+str(file_name)+".dat", 'w' )
ofile = open(model_path+"input_files/main_model.dat", 'a' )
#X=dim.X
#Z=dim.Z

#Assign your output to the OUT variable.
if const_pressures==1:

	ofile.write("grouting_pressure "+str(GP)+" \n")
	
	ofile.write("support_pressure "+str(SP)+" \n")
else:
	print("import files")
ofile.write("grouting_gradient "+str(GP_g)+" \n")

ofile.write("support_pressure "+str(SP)+" \n")
ofile.write("support_gradient "+str(SP_g)+" \n")

ofile.write("time_advance "+str(time_advance_TBM)+" \n")

ofile.write("time_ring_construction "+str(time_advance_ring)+" \n")
ofile.write("move_steps_per_round_length "+str(advance_step_per_ring)+" \n")
ofile.write("steps_per_down_time "+str(steps_per_down_time)+" \n")
if write_output==1:
	ofile.write("write_to_databese "+str(True)+" \n")
else:
	ofile.write("write_to_databese "+str(False)+" \n")
ofile.close()
OUT = ofile
# ----------------------------------------

visualisation_risk_buildig = BoolSelector(false)  # graph input

# group: Metamodel prediction building settlments
flatten_6 = List.Flatten()  # unwired: list
byGeometry_4 = ImportInstance.ByGeometry()  # unwired: geometry
map = List.Map(list=flatten_6, f_x=byGeometry_4)
red = Color.Red()  # unwired: color
green = Color.Green()  # unwired: color
create_4 = List.Create(item0=red, item1=green)
metamodel_prediction = Python(IN[0]=alignemt_solution, IN[1]=overburden, IN[2]=visualisation_risk_buildig)
# ---------- metamodel_prediction.python (171 lines) ----------
import clr
clr.AddReference('ProtoGeometry')
from Autodesk.DesignScript.Geometry import *
#The inputs to this node will be stored as a list in the IN variables.
dataEnteringNode = IN

#Assign your output to the OUT variable.

import sys
pyt_path = r'C:\Program Files (x86)\IronPython 2.7\Lib'
sys.path.append(pyt_path)
import os
#import math
#import random
#import numpy as np
from math import *
#from itertools import imap
#from operator import sub
pos=IN[0]

overburden=IN[1]
dec=IN[2]
input_array_size = 1
hidden_array_size = 1
output_array_size = 1
learning_rate = 1

#weight_ih=[[0 for x in xrange(hidden_array_size)] for x in xrange(input_array_size)] 
#weight_ho=[[0 for x in xrange(output_array_size)] for x in xrange(hidden_array_size)]

filename='D:\git-satbim_internal\Examples\Metamodel\Trained_metamodel\metamodel_build.txt'

#filename='D:\\backup_work\Metamodel\Trained_metamodel\metamodel_build.txt'

print("reading materials from file: "+str(filename))
metadata = open( filename, 'r' ).readlines()

i= 0
for a in range (0, len(metadata)):
	line= metadata[i] 

	if (a==0):
		columns = line.split()
		input_array_size = int(columns[0])
		print(input_array_size)
		i=i+1
	elif (a==1):
		columns = line.split()
		hidden_array_size = int(columns[0])
		print(hidden_array_size)
		i=i+1
	elif (a==2):
		columns = line.split()
		output_array_size = int(columns[0])
		print(output_array_size)
		i=i+1
		weight_ih=[[0 for x in xrange(hidden_array_size)] for x in xrange(input_array_size)] 
		weight_ho=[[0 for x in xrange(output_array_size)] for x in xrange(hidden_array_size)] 

	elif (a==3):
		columns = line.split()
		learning_rate = float(columns[0])
		##print(learning_rate)
		i=i+1
	elif (a==4):
		columns = line.split()

		if (len (columns)!= (input_array_size*hidden_array_size)):
			print ("wrong number of w_ih")
		else:
			m=hidden_array_size
			for x in range (0, int(input_array_size)):
				for y in range (0, int(hidden_array_size)):
					##print(str(x) +" "+str(y))
					weight_ih[x][y]=float(columns[x*m+y])
					##print(weight_ih[x][y])
		
		i=i+1
	elif (a==5):
		columns = line.split()
		##print("lrn of columns")
		##print(len (columns))
		if (len (columns)!= (int(hidden_array_size)*int(output_array_size))):
			print ("wrong number of w_ho")
		else:
			m=hidden_array_size
			for x in range (0, hidden_array_size):
				for y in range (0, output_array_size):
					##print(str(x) +" "+str(y))
					weight_ho[x][y]=float(columns[x+y])
					##print(weight_ho[x][y])
		i=i+1
	else:
		print ("Wrong size of input metamodel file")
		
#input_filename='input.txt'

#input_lines = open( input_filename, 'r' ).readlines()

#inputs=len(input_lines)

input_patterns=[[0 for x in xrange(3)] for x in xrange(4)] 
#m=0
#for line in input_lines:
#	columns = line.split()
#	input_patterns[m][0]=float(columns[0])
#	input_patterns[m][1]=float(columns[1])
#	input_patterns[m][2]=float(columns[2])

over_norm=(0.1+(0.8*(overburden/100.0-10.0)/(30.0- 10.0)))
pos_norm=(0.1+(0.8*(pos-1.0)/(5.0- 1.0)))
#	m=m+1
for i in range (0,4):
	input_patterns[i][0]=float(pos_norm)
	input_patterns[i][1]=float(over_norm)
	input_patterns[i][2]=float(0.1+i*0.266666)	
	

		
temp_forw=0.0
temp_error_=0.0
error_pattern =0.0
error=0.0
hidden=[0]*hidden_array_size
#print(input_patterns)
#print(len(input_patterns))
#print(len(input_patterns[0]))
##print(settlements)
number_of_input_patterns = 4

output=[[0 for x in xrange(output_array_size)] for x in xrange(number_of_input_patterns)]




print(weight_ih)
print(weight_ho)

for x in range (0, number_of_input_patterns):			
## Evaluate input -> hidden layer
	for z in range (0, hidden_array_size ):
		for y in range (0, input_array_size): 		
			temp_forw = temp_forw + (input_patterns[x][y] * weight_ih[y][z])		
		hidden[z] = (1.0 / (1.0 + exp(-1.0 * temp_forw)))
		temp_forw = 0.0


## Evaluate hidden -> output layer
	for z in range (0,output_array_size ):		    
		for y in range (0,hidden_array_size ):	
			temp_forw += (hidden[y] * weight_ho[y][z])
		output[x][z] = (1.0 / (1.0 + exp(-1.0 * (temp_forw ))))
		temp_forw = 0.0
		#print(output[x][z])
out_patern=[]	
for i in range (0,2):
	out_patern.append(output[i][0])
out_patern.append((output[0][0]+output[2][0])/2.0)
out_patern.append((output[1][0]+output[3][0])/2.0)
out_patern.append(output[2][0])
out_patern.append(output[3][0])#
out_patern1=[]
for i in range (0, len(out_patern)):
	pattern_new=(0.1+((out_patern[i]-0.1)/(0.9-0.1)))
	out_patern1.append(pattern_new)
	
if dec==True:
	OUT = out_patern1
else:
	OUT=False
#OUT= input_patterns
# ----------------------------------------
color_range = ColorRange(colors=create_4, value=metamodel_prediction)  # unwired: indices
overrideColorInView = Element.OverrideColorInView(element=map, color=color_range)

number_6 = DoubleInput(90)  # graph input
containsTransparentMaterials = Custom[Element.ContainsTransparentMaterials](Element_s=flatten_5, Min_Transparency=number_6)  # Checks if a given element contains transparent materials.
metamodels_file_path = StringInput("D:/backup_work/Metamodel/Trained_metamodel/surface/")  # graph input
overburden_2 = CodeBlock(a=overburden) { a; }
visualisation_settlments = BoolSelector(false)  # graph input
firstItem_3 = List.FirstItem(list=calculation_of_the_adaptive)

# group: Visualization of the surface settlments
scale_factor = DoubleSlider(1, range=1..1000 step 1)  # graph input
python_script_12 = Python(IN[0]=metamodels_file_path, IN[1]=overburden_2, IN[2]=scale_factor, IN[3]=calculation_of_the_adaptive, IN[4]=alignemt_solution, IN[5]=visualisation_settlments)
# ---------- python_script_12.python (64 lines) ----------
import clr
import sys
import math
#import readline
pyt_path = r'C:\Program Files (x86)\IronPython 2.7\Lib'
sys.path.append(pyt_path)
import os
clr.AddReference('ProtoGeometry')
clr.AddReference('RevitNodes')
from Autodesk.DesignScript.Geometry import *

import Revit
clr.ImportExtensions(Revit.Elements)

NON=1000000 #number of nodes - if knowwn enter, if not large number
#coords=[[0 for x in xrange(4)] for x in xrange(NON)]
max=1

from math import * 
params = {}
file_path= IN[0]
overburd=IN[1]
scale=IN[2]
alignment=IN[3]
alternative=IN[4]
dec=IN[5]

if dec==True:

	o_index=int(overburd/100.0-10)/5+1
	
	model=int(5*(alternative-1)+o_index)
	
	file_name=file_path+'model_'+str(model)+'.txt'
	
	file = open( file_name, 'r' )
	
	lines = file.readlines()
	file_len = len(lines)
	print(file_len)
	
	points=[]
	
	point1=alignment[1]
	
	x0=point1.X
	y0=point1.Y
	z0=point1.Z
	overburd=overburd/100.0
	
	for a in range (0,file_len):
		line= lines[a] 
		columns = line.split()
		x=float(columns[1])*100.0+x0
		y=float(columns[2])*100.0+y0
		z=float(float(columns[3])-overburd)*100.0*scale+overburd*100+z0+5.0
		point=Point.ByCoordinates(x,y,z)
		points.append(point)
		
	surface=Revit.Elements.Topography.ByPoints(points)
	OUT=surface
else:
	OUT=0
	
# ----------------------------------------
geometry_4 = Element.Geometry(element=python_script_12)
lastItem = List.LastItem(list=geometry_4)
faceVertices = Custom[Mesh.FaceVertices](Mesh=lastItem)  # Gets the vertices of each face of a given mesh
code_block_10 = CodeBlock(points=faceVertices) { a=Surface.ByPerimeterPoints(points); }
byGeometries = ImportInstance.ByGeometries()  # unwired: geometries
map_2 = List.Map(list=code_block_10, f_x=byGeometries)
green_2 = Custom[Color.Green]()  # Returns the colour green.
red_2 = Custom[Color.Red]()  # Returns the colour red.
create_5 = List.Create(item0=green_2, item1=red_2)
python_script_13 = Python(IN[0]=faceVertices, IN[1]=overburden, IN[2]=firstItem_3)
# ---------- python_script_13.python (51 lines) ----------
import clr
import sys
import math
#import readline
pyt_path = r'C:\Program Files (x86)\IronPython 2.7\Lib'
sys.path.append(pyt_path)
import os
clr.AddReference('ProtoGeometry')
from Autodesk.DesignScript.Geometry import *

NON=1000000 #number of nodes - if knowwn enter, if not large number
#coords=[[0 for x in xrange(4)] for x in xrange(NON)]
max=1

from math import * 
params = {}
points_surf=IN[0]
over=IN[1]
allin=IN[2]
list=[]

z_alin=allin.Z

for i in range (0, len(points_surf)):
	max =(points_surf[i][0].Z+points_surf[i][1].Z+points_surf[i][2].Z)/3.0
	max=(max-over-z_alin-5.0)/100
	#if points_surf[i][1].Z<max:
	#	max=points_surf[i][1].Z
	#if points_surf[i][2].Z<max:
	#	max=points_surf[i][2].Z
	list.append(float(max))
	

#OldMax=-1000000.0
#for i in range (0, len(list)):
#	if list[i]>OldMax:
#		OldMax=list[i]
#OldMin=min(list)
OldMax=0.009
OldMin=-0.045
NewMax=1.0
NewMin=0.0
list_1=[0]*len(list)
OldRange = (OldMax - OldMin)  
NewRange = (NewMax - NewMin) 
for i in range (0, len(list)):
	list_1[i] = (((list[i] - OldMin) * NewRange) / OldRange) + NewMin



OUT=list_1
# ----------------------------------------
color_range_2 = ColorRange(colors=create_5, value=python_script_13)  # unwired: indices
overrideColorInView_2 = Element.OverrideColorInView(element=map_2, color=color_range_2)
number_7 = DoubleInput(0)  # graph input
number_8 = DoubleInput(1)  # graph input
remapRange = Math.RemapRange(newMin=number_7, newMax=number_8)  # unwired: numbers
transpose = List.Transpose(lists=faceVertices)
code_block_11 = CodeBlock(a=transpose) { a[0]; a[1]; a[2]; }
byThreePoints = Plane.ByThreePoints(origin=code_block_11.out0, planePoint=code_block_11.out1, xAxisPoint=code_block_11.out2)
normal = Plane.Normal(plane=byThreePoints)
code_block_12 = CodeBlock { a=Vector.ByCoordinates(0,0,1000); }
vertexPositions = Mesh.VertexPositions(mesh=lastItem)
vertexNormals = Mesh.VertexNormals(mesh=lastItem)
number_slider = DoubleSlider(1, range=1..5 step 1)  # graph input
byPoints = NurbsSurface.ByPoints(uDegree=number_slider, vDegree=number_slider)  # unwired: points

lining_Geometry_yes_no = BoolSelector(true)  # graph input
element_geometry = Python(IN[0]=flatten_3, IN[1]=lining_Geometry_yes_no)
# ---------- element_geometry.python (27 lines) ----------
import clr
import sys
import math
#import math
#import sys
pyt_path = r'C:\Program Files (x86)\IronPython 2.7\Lib'
sys.path.append(pyt_path)
import os

clr.AddReference('ProtoGeometry')
clr.AddReference("RevitNodes")
from Autodesk.DesignScript.Geometry import *
#The inputs to this node will be stored as a list in the IN variables.
dataEnteringNode = IN
import Revit
clr.ImportExtensions(Revit.Elements)
list=IN[0]
dec=IN[1]

#Assign your output to the OUT variable.
geometry=[]

if dec==True:
	for elem in list:
		geom=Revit.Elements.Element.Geometry(elem)
		geometry.append(geom)
OUT = geometry
# ----------------------------------------
